# Grasshopper definition ICD.ABM.DigitalFutures2022_Example_PanelAgents.gh (Grasshopper 1.0.7)
# plug-ins: ICD.ABM.DigitalFutures22.Grasshopper, ABxM.Grasshopper, Human

ithreshold = Slider(2, range=0..50)
iweight = Slider(0.5, range=0..1)
iweight_2 = Slider(0.5, range=0..1)

# ---- group: RemoveAgentsBhv
removeagentbehaivor = CSharpScript(
    iThreshold=ithreshold,
    Reference=["C:\USERS\FABIAN\DESKTOP\ICD\PROJECTS\RP12\FILES\VS\ABMFIFTYMESH\ABMFIFTYMESH_VS\ABMFIFTYMESH\ABMFIFTYMESH.CORE\BIN\ABxM.Core.dll", "C:\USERS\FABIAN\DESKTOP\ICD\PROJECTS\RP12\FILES\VS\ICD.ABM.DIGITALFUTURES22\ICD.ABM.DIGITALFUTURES22.CORE\BIN\DEBUG\NET45\ICD.ABM.DigitalFutures22.Core.dll"])  # -> out, oBehavior; inputs iThreshold: Double
# ---------- removeagentbehaivor: C# usings ----------
using ABxM.Core;
using ABxM.Core.Agent;
using ABxM.Core.AgentSystem;
using ABxM.Core.Behavior;
using ABxM.Core.Environments;

using ICD.ABM.DigitalFutures22.Core.Agent;
using ICD.ABM.DigitalFutures22.Core.AgentSystem;
using ICD.ABM.DigitalFutures22.Core.Environments;
# ---------- removeagentbehaivor: C# ----------
    behavior.Threshold = iThreshold;
    oBehavior = behavior;
# ---------- removeagentbehaivor: C# additional code ----------
  RemoveAgentBehavior behavior = new RemoveAgentBehavior();

  public class RemoveAgentBehavior : BehaviorBase
  {
    public double Threshold;

    private static Random random = new Random();

    public RemoveAgentBehavior()
    {
    }

    public override void Execute(AgentBase agent)
    {

      PanelAgent myAgent = agent as PanelAgent;
      PanelAgentSystem system = myAgent.AgentSystem as PanelAgentSystem;

      foreach(PanelAgent otherAgent in myAgent.DirectNeighborsOnRail)
      {
        if(myAgent.Position.DistanceTo(otherAgent.Position) < Threshold)
        {
          system.RemoveAgent(otherAgent);
        }
      }
    }
  }
# ---------- end removeagentbehaivor ----------

# ----
movetoneighborbhv = CSharpScript(
    iDistance=Slider(200, range=0..500),
    iStep=Slider(0.001, range=0..10),
    iWeight=iweight,
    Reference=["C:\USERS\FABIAN\DESKTOP\ICD\PROJECTS\RP12\FILES\VS\ICD.ABM.DIGITALFUTURES22\ICD.ABM.DIGITALFUTURES22.CORE\BIN\DEBUG\NET45\ICD.ABM.DigitalFutures22.Core.dll", "C:\Users\Fabian\AppData\Roaming\Grasshopper\Libraries\ABxM.Core.dll"])  # -> out, oBehavior; inputs iDistance: Double, iStep: Double, iWeight: Double
# ---------- movetoneighborbhv: C# usings ----------
using System.Linq;

using ABxM.Core;
using ABxM.Core.Agent;
using ABxM.Core.AgentSystem;
using ABxM.Core.Behavior;
using ABxM.Core.Environments;

using ICD.ABM.DigitalFutures22.Core.Agent;
using ICD.ABM.DigitalFutures22.Core.AgentSystem;
using ICD.ABM.DigitalFutures22.Core.Environments;
# ---------- movetoneighborbhv: C# ----------
    behavior.Stepsize = iStep;
    behavior.Distance = iDistance;
    behavior.Weight = iWeight;
    oBehavior = behavior;
# ---------- movetoneighborbhv: C# additional code ----------
  MoveToNeighborBehavior behavior = new MoveToNeighborBehavior(1.0, 1.0);

  public class MoveToNeighborBehavior : BehaviorBase
  {
    public double Stepsize;
    public double Distance;

    public MoveToNeighborBehavior(double _stepsize, double _weight)
    {
      Stepsize = _stepsize;
      Weight = _weight;
    }

    public override void Execute(AgentBase agent)
    {
      double Factor = Stepsize * 1000;

      PanelAgent myAgent = agent as PanelAgent;
      PanelAgentSystem mySystem = myAgent.AgentSystem as PanelAgentSystem;

      List<double> distances = new List<double>();

      foreach(PanelAgent neighbor in myAgent.DirectNeighborsOnRail)
      {
        distances.Add(myAgent.UV.DistanceTo(neighbor.UV));
      }

      double minVal = distances.Min();
      int index = distances.IndexOf(minVal);

      if(minVal > Distance)
      {
        Vector2d move2D = myAgent.DirectNeighborsOnRail[index].UV - myAgent.UV;
        move2D.Unitize();

        move2D *= Factor;

        myAgent.Moves.Add(move2D);
        myAgent.Weights.Add(Weight);

        myAgent.DirectNeighborsOnRail[index].Moves.Add(-move2D);
        myAgent.DirectNeighborsOnRail[index].Weights.Add(Weight);
      }
    }
  }
# ---------- end movetoneighborbhv ----------
movefromboundarybhv = CSharpScript(
    iStep=Slider(0.001, range=0..10),
    iWeight=iweight_2,
    Reference=["C:\USERS\FABIAN\DESKTOP\ICD\PROJECTS\RP12\FILES\VS\ICD.ABM.DIGITALFUTURES22\ICD.ABM.DIGITALFUTURES22.CORE\BIN\DEBUG\NET45\ICD.ABM.DigitalFutures22.Core.dll", "C:\Users\Fabian\AppData\Roaming\Grasshopper\Libraries\ABxM.Core.dll"])  # -> out, oBehavior; inputs iStep: Double, iWeight: Double
# ---------- movefromboundarybhv: C# ----------
    behavior.Stepsize = iStep;
    behavior.Weight = iWeight;
    oBehavior = behavior;
# ---------- movefromboundarybhv: C# additional code ----------
  MoveToFromBoundaryBehavior behavior = new MoveToFromBoundaryBehavior(1.0, 1.0);

  public class MoveToFromBoundaryBehavior : BehaviorBase
  {
    public double Stepsize;
    Point2d prevTarget;

    public MoveToFromBoundaryBehavior(double _stepsize, double _weight)
    {
      Stepsize = _stepsize;
      Weight = _weight;
    }

    public override void Execute(AgentBase agent)
    {
      double Factor = Stepsize * 1000;

      PanelAgent myAgent = agent as PanelAgent;
      PanelAgentSystem mySystem = myAgent.AgentSystem as PanelAgentSystem;

      List<Curve> boundaryCurves = new List<Curve>();
      boundaryCurves.AddRange(myAgent.Rail.Curves2D);

      List<double> distances = new List<double>();
      List<Point3d> cPoints = new List<Point3d>();

      List<double> lengths = new List<double>();

      // find closest curve to push away from
      foreach(Curve c in boundaryCurves)
      {
        lengths.Add(c.GetLength());
        double param = 0.0;
        c.ClosestPoint(new Point3d(myAgent.UV.X, myAgent.UV.Y, 0.0), out param);
        Point3d t = c.PointAt(param);
        cPoints.Add(t);
        distances.Add(new Point3d(myAgent.UV.X, myAgent.UV.Y, 0.0).DistanceTo(t));
      }

      double minVal = distances.Min();
      int index = distances.IndexOf(minVal);

      Point2d targetPoint = new Point2d(cPoints[index].X, cPoints[index].Y);

      Vector2d move2D = myAgent.UV - targetPoint;
      double len = move2D.Length;

      move2D.Unitize();

      move2D *= (200 - (2 * len)) / 100;

      myAgent.Moves.Add(move2D);
      myAgent.Weights.Add(Weight);
    }
  }
# ---------- end movefromboundarybhv ----------

rails = Surface([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])
# © 2022 by ICD University of Stuttgart
ref_srf = Surface(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)

popgeo = PopulateGeometry(Geometry=rails, Count=Slider(5, range=2..50), Seed=1)
panelagent = GhcDefinePanelAgent(UVPosition=flatten(popgeo), Behaviors=[movefromboundarybhv.oBehavior, removeagentbehaivor.oBehavior])
ghcdefinerailenvironment = GhcDefineRailEnvironment(SingleBrep=ref_srf, RailSurfaces=rails)
panelagentsystem = GhcDefinePanelAgentSystem(RailEnvironment=ghcdefinerailenvironment, PanelAgents=panelagent)
solver = StepByStepSolver(Reset=Button(), Execute=Toggle(False), AgentSystems=panelagentsystem)  # -> DisplayGeometries, AllAgentSystems, IterationCount
panel = Panel(solver.IterationCount)
vispanelas = GhcVisPanelAS(PanelAgentSystem=solver.AllAgentSystems, OutputGeometry=Toggle(False), CutPanels=Toggle(False))  # -> AgentFrames, CellPolylines, Mesh, NeighborsOnRail, PanelCuts, CutPlanes, PanelBrep, PanelArea
pt = Point(vispanelas.AgentFrames)
crv = Curve(vispanelas.CellPolylines)
mesh = Mesh(vispanelas.Mesh)
crv_2 = Curve(vispanelas.NeighborsOnRail)
crv_3 = Curve(vispanelas.PanelCuts)
pln = Plane(vispanelas.CutPlanes)
brep = Brep(vispanelas.PanelBrep)
number_slider = Slider(0, range=0..9)
panel_2 = Panel(vispanelas.PanelArea)
item = ListItem(List=pt, Index=number_slider, Wrap=True)
item_2 = ListItem(List=brep, Index=number_slider, Wrap=True)
branch = TreeBranch(Tree=crv_3, Path=number_slider, MaintainPaths=True)
branch_2 = TreeBranch(Tree=crv_2, Path=number_slider, MaintainPaths=True)
branch_3 = TreeBranch(Tree=pln, Path=number_slider, MaintainPaths=True)
previewlw = CustomPreviewLineweights(Geometry=crv_3, Shader=ColourSwatch(SwatchColor=RGB(0, 195, 255)), Thickness=Slider(5, range=0..10), Absolute=False)
