# Grasshopper definition Umbilical_system.gh (Grasshopper 1.0.7)
# plug-ins: ICD.AbmFramework.Grasshopper

srf = Surface(reparameterize(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))
md_slider = MDSlider(
    SliderMode=0,
    slider_value=Point(0.2711620796, 0.4862265238, 0.5),
    x_domain=Domain(0, 1),
    y_domain=Domain(0, 1),
    z_domain=Domain(0, 1))
popgeo = PopulateGeometry(Geometry=srf, Count="3", Seed=Slider(4, range=0..10))

# ---- group: Random walk
separation = CSharpScript(
    iStep=Slider(0.02, range=0..1),
    Reference=["C:\USERS\TOBIAS SCHWINN\APPDATA\ROAMING\GRASSHOPPER\LIBRARIES\ICD.AbmFramework.Core.dll", "C:\Users\Tobias Schwinn\AppData\Roaming\Grasshopper\Libraries\ICD.ABM.DigitalFutures22.Core.dll"])  # -> out, oBehavior; inputs iStep: Double
# ---------- separation: C# usings ----------
using ICD.AbmFramework.Core;
using ICD.AbmFramework.Core.Agent;
using ICD.AbmFramework.Core.AgentSystem;
using ICD.AbmFramework.Core.Behavior;
using ICD.AbmFramework.Core.Environments;

using ICD.ABM.DigitalFutures22.Core.Agent;
using ICD.ABM.DigitalFutures22.Core.AgentSystem;
# ---------- separation: C# ----------
    behavior.Stepsize = iStep;
    oBehavior = behavior;
# ---------- separation: C# additional code ----------
  WanderingUVBehavior behavior = new WanderingUVBehavior(1.0);

  public class WanderingUVBehavior : BehaviorBase
  {
    public double Stepsize;
    Random rand = new Random();

    public WanderingUVBehavior(double _stepsize)
    {
      Stepsize = _stepsize;
      Weight = 1.0;
    }

    public override void Execute(AgentBase agent)
    {
      UmbilicalAgent myAgent = (UmbilicalAgent) agent;
      UmbilicalAgentSystem mySystem = (UmbilicalAgentSystem) myAgent.AgentSystem;

      Vector2d moveVector = Vector2d.Zero;

      moveVector.X = rand.NextDouble() - 0.5;
      moveVector.Y = rand.NextDouble() - 0.5;

      moveVector.Unitize();

      moveVector *= Stepsize;

      //make sure the agent stays within boundaries
      Point2d nextPostion = myAgent.UV + moveVector;
      if(nextPostion.X < mySystem.SystemSurface.Domain(0).Min || nextPostion.X > mySystem.SystemSurface.Domain(0).Max)
      {
        moveVector.X *= -1;
      } else if (nextPostion.Y < mySystem.SystemSurface.Domain(1).Min || nextPostion.Y > mySystem.SystemSurface.Domain(1).Max)
      {
        moveVector.Y *= -1;
      }

      myAgent.Moves.Add(moveVector);
      myAgent.Weights.Add(Weight);
    }
  }
# ---------- end separation ----------

# ---- group: Ascent
separation_2 = CSharpScript(
    iStep=Slider(0.05, range=0..10),
    iFlip=Toggle(False),
    Reference=["C:\USERS\TOBIAS SCHWINN\APPDATA\ROAMING\GRASSHOPPER\LIBRARIES\ICD.AbmFramework.Core.dll", "C:\Users\Tobias Schwinn\AppData\Roaming\Grasshopper\Libraries\ICD.ABM.DigitalFutures22.Core.dll"])  # -> out, oBehavior; inputs iStep: Double, iFlip: Boolean
# ---------- separation_2: C# ----------
    behavior.Stepsize = iStep;
    behavior.Flip = iFlip;
    oBehavior = behavior;
# ---------- separation_2: C# additional code ----------
  DescentUVBehavior behavior = new DescentUVBehavior(1.0);

  public class DescentUVBehavior : BehaviorBase
  {
    public double Stepsize;
    public bool Flip;
    //public Vector3d derivatives[1];

    public DescentUVBehavior(double _stepsize)
    {
      Stepsize = _stepsize;
      Weight = 1.0;
    }

    public override void Execute(AgentBase agent)
    {
      UmbilicalAgent myAgent = (UmbilicalAgent) agent;
      UmbilicalAgentSystem mySystem = (UmbilicalAgentSystem) myAgent.AgentSystem;

      // get the slope at the current location
      Point3d currentPoint = mySystem.SystemSurface.PointAt(myAgent.UV.X, myAgent.UV.Y);
      Vector3d upVector = Vector3d.ZAxis;
      double u, v = 0.0;
      mySystem.SystemSurface.ClosestPoint(currentPoint + upVector, out u, out v);
      Point3d targetPoint = mySystem.SystemSurface.PointAt(u, v);
      Vector3d targetVector = targetPoint - currentPoint;
      targetVector.Unitize();
      Vector3d targetVectorXY = new Vector3d(targetVector.X, targetVector.Y, 0);

      double slope = targetVector.Z / targetVectorXY.Length;
      //double slopeV = derivatives[1].Y / derivatives[1].X;
      
      if(Flip)
        slope *= -1;

      Vector2d move2D = new Point2d(u, v) - myAgent.UV;
      move2D.Unitize();
      move2D *= slope * Stepsize;

      myAgent.Moves.Add(move2D);
      myAgent.Weights.Add(Weight);
    }
  }
# ---------- end separation_2 ----------

# ----
srf_cp = SurfaceClosestPoint(Point=popgeo, Surface=srf)  # -> Point, UVPoint, Distance
c_script = CSharpScript(iSurf=srf, iUV=md_slider)  # -> out, A, B; inputs iSurf: Surface, iUV: Point3d
# ---------- c_script: C# ----------
    Vector3d[] derivatives;
    Point3d point = Point3d.Unset;
    iSurf.Evaluate(iUV.X, iUV.Y, 1, out point, out derivatives);

    for (int i = 0; i < derivatives.Length; i++)
    {
      derivatives[i].Unitize();
    }

    A = point;
    B = derivatives[1];
# ---------- end c_script ----------
c_script_2 = CSharpScript(iSurf=srf, iUV=md_slider)  # -> out, A, B; inputs iSurf: Surface, iUV: Point3d
# ---------- c_script_2: C# ----------
    SurfaceCurvature curvature = iSurf.CurvatureAt(iUV.X, iUV.Y);
    Vector3d maxDir = curvature.Direction(0);
    Point3d point = curvature.Point;


    A = point;
    B = maxDir;
# ---------- end c_script_2 ----------
c_script_3 = CSharpScript(
    initialUV=srf_cp.UVPoint,
    iBehaviors=separation_2.oBehavior,
    Reference=["C:\USERS\TOBIAS SCHWINN\APPDATA\ROAMING\GRASSHOPPER\LIBRARIES\ICD.AbmFramework.Core.dll", "C:\Users\Tobias Schwinn\AppData\Roaming\Grasshopper\Libraries\ICD.ABM.DigitalFutures22.Core.dll"])  # -> out, oAgent; inputs initialUV: Point3d, iBehaviors: list
# ---------- c_script_3: C# usings ----------
using System.IO;
using System.Linq;
using System.Data;
using System.Drawing;
using System.Reflection;
using System.Windows.Forms;
using System.Xml;
using System.Xml.Linq;
using System.Runtime.InteropServices;

using Rhino.DocObjects;
using Rhino.Collections;
using GH_IO;
using GH_IO.Serialization;
using ICD.AbmFramework.Core;
using ICD.AbmFramework.Core.Utilities;
using ICD.AbmFramework.Core.Environments;
using ICD.AbmFramework.Core.Behavior;
using ICD.AbmFramework.Core.Agent;
using ICD.AbmFramework.Core.AgentSystem;

using ICD.ABM.DigitalFutures22.Core.Agent;
using ICD.ABM.DigitalFutures22.Core.AgentSystem;
# ---------- c_script_3: C# ----------
    //if (iAgents.Count != iIndices.Count)
    //  throw new ArgumentException("Lists of agents and indices must be the same size!");

    List<BehaviorBase> behaviors = new List<BehaviorBase>();
    foreach (BehaviorBase behavior in iBehaviors)
    {
      behaviors.Add(behavior);
    }

    oAgent = new UmbilicalAgent(new Point2d(initialUV.X, initialUV.Y), behaviors);
# ---------- end c_script_3 ----------
iso = IsoCurve(Surface=srf, UVPoint=md_slider)  # -> UIsocurve, VIsocurve
crv = Curve(iso.VIsocurve)
amp = Amplitude(Vector=c_script_2.B, Amplitude=Slider(100, range=0..100))
c_script_4 = CSharpScript(
    iSurface=srf,
    iAgents=c_script_3.oAgent,
    Reference=["C:\Users\Tobias Schwinn\AppData\Roaming\Grasshopper\Libraries\ICD.AbmFramework.Core.dll", "C:\Users\Tobias Schwinn\AppData\Roaming\Grasshopper\Libraries\ICD.ABM.DigitalFutures22.Core.dll"])  # -> out, oAgentSystem; inputs iSurface: Surface, iAgents: list
# ---------- c_script_4: C# ----------
    List<UmbilicalAgent> agents = new List<UmbilicalAgent>();
    foreach (UmbilicalAgent agent in iAgents)
      agents.Add(agent);

    UmbilicalAgentSystem agentSystem = new UmbilicalAgentSystem(agents);
    agentSystem.SystemSurface = iSurface;

    oAgentSystem = agentSystem;
# ---------- end c_script_4 ----------
python = GhPythonScript(x=c_script_3.oAgent)  # -> out, a
# ---------- python: Python ----------
a = x.UV
# ---------- end python ----------
vdis = VectorDisplay(Anchor=c_script_2.A, Vector=amp)
toggle = BooleanToggle(False)
trigger = Trigger(Interval=-1000, TimerInterval=1000, Target=solver)  # disabled
panel = Panel(python.a)
solver_silent = SilentSolver(Execute=toggle, AgentSystems=c_script_4.oAgentSystem, MaxIterationCount="1")  # -> DisplayGeometries, AllAgentSystems, IterationCount; disabled
solver = StepByStepSolver(Reset=Button(), Execute=toggle, AgentSystems=c_script_4.oAgentSystem)  # -> DisplayGeometries, AllAgentSystems, IterationCount
panel_2 = Panel(solver.IterationCount)
