# Grasshopper definition ICD.ABM.DigitalFutures2022_Example.gh (Grasshopper 1.0.7)
# plug-ins: ICD.ABM.DigitalFutures22.Grasshopper, ICD.AbmFramework.Grasshopper

# ----
# © 2022 by ICD University of Stuttgart
# Reference Surface
number_slider = Slider(47, range=2..50)
# Agent Behaviors
srf = Surface(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)
popgeo = PopulateGeometry(Geometry=srf, Count=number_slider, Seed=1)

# ----
# Surface Attraction Behavior
weight = Slider(1, range=0..10)
bhvsrfattr = GhcBhvSrfAttr(Surface=srf, Weight=weight)

# ----
# Cohesion Behavior
distance = Slider(784.546, range=0..2000)
weight_2 = Slider(0.822, range=0..10)
ghcbhvcohesion = GhcBhvCohesion(Distance=distance, Weight=weight_2)

# ----
# Separation Behavior
power = Slider(0.349, range=0..10)
distance_2 = Slider(1024.011, range=0..2000)
weight_3 = Slider(1.078, range=0..10)
ghcseparation = GhcSeparation(Distance=distance_2, Power=power, AffectSelf=Toggle(True), Weight=weight_3)

# ----
# Define agents and their behaviors
dfagent = GhcDefineDFAgent(Positions=popgeo, Behaviors=[bhvsrfattr, ghcseparation, ghcbhvcohesion])

# ----
# Define single brep environment
number_slider_2 = Slider(100, range=0.1..1000)
ghcdefinesinglebrepenvironment = GhcDefineSingleBrepEnvironment(SingleBrep=srf, Spacing=number_slider_2)

# ----
# Define agent system
panel = Panel("0")
dfagentsystem = GhcDefineDFAgentSystem(CartesianEnvironment=ghcdefinesinglebrepenvironment, CartesianAgents=dfagent, ComputeDiagram=panel)

# ----
# Solver
button = Button()
toggle = BooleanToggle(False)
solver_silent = SilentSolver(Execute=toggle, MaxIterationCount="1000")  # -> DisplayGeometries, AllAgentSystems, IterationCount; disabled
solver = StepByStepSolver(Reset=button, Execute=toggle, AgentSystems=dfagentsystem)  # -> DisplayGeometries, AllAgentSystems, IterationCount
panel_2 = Panel(solver.IterationCount)
pln = Plane(solver.DisplayGeometries)

# ----
# test to possibly rebuild surface based on agent positions (if not pulled back completely to reference surface)
patch = Patch(Points=pln, Spans=20, Flexibility=1, Trim=True)
preview = CustomPreview(Geometry=patch, Material=ColourSwatch(SwatchColor=RGBA(94, 94, 94, 34)))

msphere = MeshSphere(Base=pln, Radius="100", UCount=10, VCount=20)
preview_2 = CustomPreview(
    Geometry=msphere,
    Material={diffuse=RGB(221, 160, 221), emission=RGB(66, 48, 66), shine=0.5, specular=RGB(255, 255, 255), transparency=0})
